# Dynamo graph C3D.dyn (Dynamo 2.4.1.6394)

SLAB_TRACK = TBMDesigner.Domain.SleeperType.SLAB_TRACK()
WOODEN = TBMDesigner.Domain.SleeperType.WOODEN()
CONCRETE = TBMDesigner.Domain.SleeperType.CONCRETE()

# group: Input
vehicle_data_specification_json = StringInput("C:\Users\linp3\Source\Repos\peggylin-hub\TBMDesigner\TBMDesignerFunctions\Resources\VehicleData.json")  # "Vehicle Data Specification Json Path"; graph input
index_of_vehicle_type = DoubleSlider(0, range=0..16 step 1)  # graph input
track_alignment_data_excel_file = StringInput("D:\_PROJECTs\60654007 Track Recon Stanwell Park\60654007 CDA centrelines at 1m intervals.xlsx")  # "Track alignment data excel file path"; graph input
sheet_tab_name = StringInput("Up Tunnel")  # graph input
project_base_point_easting = DoubleInput(297500)
project_base_point_northing = DoubleInput(1210600)
code_block = CodeBlock(sleeper=CONCRETE) { sleeper; }
railcorp_specifation_json_path = StringInput("C:\Users\linp3\Source\Repos\peggylin-hub\TBMDesigner\TBMDesignerFunctions\Resources\RailcorpSpecs.json")  # graph input
index_of_track_type = DoubleSlider(1, range=0..6 step 1)  # graph input
sat_file_location = Directory("D:\_PROJECTs\60654007 Track Recon Stanwell Park")

vechicleTypeList = TBMDesigner.Dynamo.KinematicEnvelopeCalculation.VechicleTypeList(VechicleJsonFilePath=vehicle_data_specification_json)
getItemAtIndex = List.GetItemAtIndex(list=vechicleTypeList, index=index_of_vehicle_type)

# group: get AutoCAD information and create layer
current = Autodesk.AutoCAD.DynamoNodes.Document.Current()
create = Autodesk.AutoCAD.DynamoNodes.Layer.Create(name=getItemAtIndex, document=current)  # frozen
code_block_2 = CodeBlock(layer=create) { layer.Name; }
blocks = Autodesk.AutoCAD.DynamoNodes.Document.Blocks(document=current)
code_block_3 = CodeBlock(ls=blocks)
# ---------- code_block_3.designscript (2 lines) ----------
//get model space
ls[0];
# ----------------------------------------
currentLayer = Autodesk.AutoCAD.DynamoNodes.Document.CurrentLayer(document=current)

# group: Import Geometry to AutoCAD
byGeometry = Autodesk.AutoCAD.DynamoNodes.Object.ByGeometry(layer=code_block_2, block=code_block_3)  # frozen; unwired: geometry

file_from_path = FileObject(path=track_alignment_data_excel_file)
importExcel = Data.ImportExcel(file=file_from_path, sheetName=sheet_tab_name)
code_block_4 = CodeBlock(ls=importExcel)
# ---------- code_block_4.designscript (3 lines) ----------
//remove the table title
newls=List.DropItems(ls,1);
List.Transpose(newls);
# ----------------------------------------
code_block_5 = CodeBlock(ls=code_block_4.out1, x0=project_base_point_easting, y0=project_base_point_northing) { ch=ls[0]; x=ls[1]-x0; y=ls[2]-y0; z=ls[3]; r=ls[4]; curveType=ls[5]; curveSide=ls[6]; e=ls[7]; }
trackSpecification = TBMDesigner.Dynamo.KinematicEnvelopeCalculation.TrackSpecification(SpecJsonFilePath=railcorp_specifation_json_path)
getItemAtIndex_2 = List.GetItemAtIndex(list=trackSpecification, index=index_of_track_type)
kinematicEnvelope = TBMDesigner.Dynamo.KinematicEnvelopeCalculation.KinematicEnvelope(curveTypes=code_block_5.curveType, curveRadiuses=code_block_5.r, superElevations=code_block_5.e, curveSides=code_block_5.curveSide, sleeperType=code_block, SpecificationName=getItemAtIndex_2, vehicleType=getItemAtIndex, VechileDataFilePath=vehicle_data_specification_json, SpecificationPath=railcorp_specifation_json_path)
code_block_6 = CodeBlock(ls=kinematicEnvelope.KE0_Static) { newls=List.Transpose(ls); x=newls[0]/1000; y=newls[1]/1000; pts=Point.ByCoordinates(x,y); }
create_polylines = Python(IN[0]=code_block_6.pts)
# ---------- create_polylines.python (17 lines) ----------
# Load the Python Standard and DesignScript Libraries
import sys
import clr
clr.AddReference('ProtoGeometry')
from Autodesk.DesignScript.Geometry import *

# The inputs to this node will be stored as a list in the IN variables.
points = IN[0]

# Place your code below this line

# Assign your output to the OUT variable.
OUT = []

for pts in points:
	pt = Point.PruneDuplicates(pts)
	OUT.append( PolyCurve.ByPoints(pt, True))
# ----------------------------------------
code_block_7 = CodeBlock { origin=Point.ByCoordinates(0,0,0); }
XAxis = Vector.XAxis()
reverse = Vector.Reverse(vector=XAxis)
ZAxis = Vector.ZAxis()
YAxis = Vector.YAxis()
byOriginVectors = CoordinateSystem.ByOriginVectors(origin=code_block_7, xAxis=reverse, yAxis=ZAxis, zAxis=YAxis)
code_block_8 = CodeBlock(x=code_block_5.x, y=code_block_5.y, z=code_block_5.z)
# ---------- code_block_8.designscript (4 lines) ----------
pts=Point.ByCoordinates(x,y,z);
pl=PolyCurve.ByPoints(pts);
pa=PolyCurve.ParameterAtPoint(pl, pts);
co=PolyCurve.CoordinateSystemAtParameter(pl, pa);
# ----------------------------------------
transform = Geometry.Transform(geometry=create_polylines, fromCoordinateSystem=byOriginVectors, contextCoordinateSystem=code_block_8.co)
python_script = Python(IN[0]=transform)
# ---------- python_script.python (18 lines) ----------
# Load the Python Standard and DesignScript Libraries
import sys
import clr
clr.AddReference('ProtoGeometry')
from Autodesk.DesignScript.Geometry import *

# The inputs to this node will be stored as a list in the IN variables.
data = IN[0]

# Place your code below this line

# Assign your output to the OUT variable.
OUT = []

for i in range(0, len(data)-1):
	d1 = data[i]
	d2 = data[i + 1]
	OUT.append([d1,d2])
# ----------------------------------------
byLoft = Solid.ByLoft(crossSections=python_script)
translate = Geometry.Translate(geometry=byLoft, xTranslation=project_base_point_easting, yTranslation=project_base_point_northing)
directory_from_path = DirectoryObject(path=sat_file_location)
code_block_9 = CodeBlock(dir=directory_from_path, railName=sheet_tab_name, envelopeName=getItemAtIndex) { dir+"\\"+railName+"_"+envelopeName+"_KE0"+".sat"; dir; railName; envelopeName; }
exportToSAT = ExportWithUnits(geometry=translate, filePath=code_block_9.out0, SelectedExportedUnitsSource=[0, 1, 2, 3, 5, 4], SelectedExportedUnit=5)
code_block_10 = CodeBlock(ls=kinematicEnvelope.KE1_Body_Roll_Positive_TT) { newls=List.Transpose(ls); x=newls[0]/1000; y=newls[1]/1000; pts=Point.ByCoordinates(x,y); }
create_polylines_2 = Python(IN[0]=code_block_10.pts)  # same code as create_polylines
transform_2 = Geometry.Transform(geometry=create_polylines_2, fromCoordinateSystem=byOriginVectors, contextCoordinateSystem=code_block_8.co)
python_script_2 = Python(IN[0]=transform_2)  # same code as python_script
byLoft_2 = Solid.ByLoft(crossSections=python_script_2)
translate_2 = Geometry.Translate(geometry=byLoft_2, xTranslation=project_base_point_easting, yTranslation=project_base_point_northing)
code_block_11 = CodeBlock(dir=code_block_9.dir, railName=code_block_9.railName, envelopeName=code_block_9.envelopeName) { dir+"\\"+railName+"_"+envelopeName+"_KE1"+".sat"; dir; railName; envelopeName; }
exportToSAT_2 = ExportWithUnits(geometry=translate_2, filePath=code_block_11.out0, SelectedExportedUnitsSource=[0, 1, 2, 3, 5, 4], SelectedExportedUnit=5)
code_block_12 = CodeBlock(ls=kinematicEnvelope.KE2_Bounce_Positive_TT) { newls=List.Transpose(ls); x=newls[0]/1000; y=newls[1]/1000; pts=Point.ByCoordinates(x,y); }
create_polylines_3 = Python(IN[0]=code_block_12.pts)  # same code as create_polylines
transform_3 = Geometry.Transform(geometry=create_polylines_3, fromCoordinateSystem=byOriginVectors, contextCoordinateSystem=code_block_8.co)
python_script_3 = Python(IN[0]=transform_3)  # same code as python_script
byLoft_3 = Solid.ByLoft(crossSections=python_script_3)
translate_3 = Geometry.Translate(geometry=byLoft_3, xTranslation=project_base_point_easting, yTranslation=project_base_point_northing)
code_block_13 = CodeBlock(dir=code_block_11.dir, railName=code_block_11.railName, envelopeName=code_block_11.envelopeName) { dir+"\\"+railName+"_"+envelopeName+"_KE2"+".sat"; dir; railName; envelopeName; }
exportToSAT_3 = ExportWithUnits(geometry=translate_3, filePath=code_block_13.out0, SelectedExportedUnitsSource=[0, 1, 2, 3, 5, 4], SelectedExportedUnit=5)
code_block_14 = CodeBlock(ls=kinematicEnvelope.KE3_Body_Roll_Negative_TT) { newls=List.Transpose(ls); x=newls[0]/1000; y=newls[1]/1000; pts=Point.ByCoordinates(x,y); }
create_polylines_4 = Python(IN[0]=code_block_14.pts)  # same code as create_polylines
transform_4 = Geometry.Transform(geometry=create_polylines_4, fromCoordinateSystem=byOriginVectors, contextCoordinateSystem=code_block_8.co)
python_script_4 = Python(IN[0]=transform_4)  # same code as python_script
byLoft_4 = Solid.ByLoft(crossSections=python_script_4)
translate_4 = Geometry.Translate(geometry=byLoft_4, xTranslation=project_base_point_easting, yTranslation=project_base_point_northing)
code_block_15 = CodeBlock(dir=code_block_13.dir, railName=code_block_13.railName, envelopeName=code_block_13.envelopeName) { dir+"\\"+railName+"_"+envelopeName+"_KE3"+".sat"; dir; railName; envelopeName; }
exportToSAT_4 = ExportWithUnits(geometry=translate_4, filePath=code_block_15.out0, SelectedExportedUnitsSource=[0, 1, 2, 3, 5, 4], SelectedExportedUnit=5)
code_block_16 = CodeBlock(ls=kinematicEnvelope.KE4_Bounce_Negative_TT) { newls=List.Transpose(ls); x=newls[0]/1000; y=newls[1]/1000; pts=Point.ByCoordinates(x,y); }
create_polylines_5 = Python(IN[0]=code_block_16.pts)  # same code as create_polylines
transform_5 = Geometry.Transform(geometry=create_polylines_5, fromCoordinateSystem=byOriginVectors, contextCoordinateSystem=code_block_8.co)
python_script_5 = Python(IN[0]=transform_5)  # same code as python_script
byLoft_5 = Solid.ByLoft(crossSections=python_script_5)
translate_5 = Geometry.Translate(geometry=byLoft_5, xTranslation=project_base_point_easting, yTranslation=project_base_point_northing)
code_block_17 = CodeBlock(dir=code_block_15.dir, railName=code_block_15.railName, envelopeName=code_block_15.envelopeName) { dir+"\\"+railName+"_"+envelopeName+"_KE4"+".sat"; dir; railName; envelopeName; }
exportToSAT_5 = ExportWithUnits(geometry=translate_5, filePath=code_block_17.out0, SelectedExportedUnitsSource=[0, 1, 2, 3, 5, 4], SelectedExportedUnit=5)
code_block_18 = CodeBlock(ls=kinematicEnvelope.Structural_Gauge) { newls=List.Transpose(ls); x=newls[0]/1000; y=newls[1]/1000; pts=Point.ByCoordinates(x,y); }
create_polylines_6 = Python(IN[0]=code_block_18.pts)  # same code as create_polylines
transform_6 = Geometry.Transform(geometry=create_polylines_6, fromCoordinateSystem=byOriginVectors, contextCoordinateSystem=code_block_8.co)
python_script_6 = Python(IN[0]=transform_6)  # same code as python_script
byLoft_6 = Solid.ByLoft(crossSections=python_script_6)
translate_6 = Geometry.Translate(geometry=byLoft_6, xTranslation=project_base_point_easting, yTranslation=project_base_point_northing)
code_block_19 = CodeBlock(dir=code_block_17.dir, railName=code_block_17.railName, envelopeName=code_block_17.envelopeName) { dir+"\\"+railName+"_"+envelopeName+"_KE5"+".sat"; dir; railName; envelopeName; }
exportToSAT_6 = ExportWithUnits(geometry=translate_6, filePath=code_block_19.out0, SelectedExportedUnitsSource=[0, 1, 2, 3, 5, 4], SelectedExportedUnit=5)
