# Dynamo graph C3D_Combined.dyn "C3D_2" (Dynamo 2.5.2.7915)

CONCRETE = TBMDesigner.Domain.SleeperType.CONCRETE()

# group: Input
track_alignment_data_excel_file = StringInput("D:\_PROJECTs\60654007 Track Recon Stanwell Park\60654007 CDA centrelines at 1m intervals.xlsx")  # "Track alignment data excel file path"; graph input
sheet_tab_name = StringInput("Up Tunnel")  # graph input
project_base_point_easting = DoubleInput(297500)
project_base_point_northing = DoubleInput(1210600)
code_block = CodeBlock(sleeper=CONCRETE) { sleeper; }
railcorp_specifation_json_path = StringInput("C:\Users\linp3\Source\Repos\peggylin-hub\TBMDesigner\TBMDesignerFunctions\Resources\RailcorpSpecs.json")  # graph input
index_of_track_type = DoubleSlider(1, range=0..6 step 1)  # graph input
vehicle_data_specification_json = StringInput("C:\Users\linp3\Source\Repos\peggylin-hub\TBMDesigner\TBMDesignerFunctions\Resources\VehicleData.json")  # "Vehicle Data Specification Json Path"; graph input
index_of_vehicle_type = DoubleSlider(0, range=0..16 step 1)  # graph input
sat_file_location = Directory("D:\_PROJECTs\60654007 Track Recon Stanwell Park")

file_from_path = FileObject(path=track_alignment_data_excel_file)
importExcel = Data.ImportExcel(file=file_from_path, sheetName=sheet_tab_name)
code_block_2 = CodeBlock(ls=importExcel)
# ---------- code_block_2.designscript (3 lines) ----------
//remove the table title
newls=List.DropItems(ls,1);
List.Transpose(newls);
# ----------------------------------------
code_block_3 = CodeBlock(ls=code_block_2.out1, x0=project_base_point_easting, y0=project_base_point_northing) { ch=ls[0]; x=ls[1]-x0; y=ls[2]-y0; z=ls[3]; r=ls[4]; curveType=ls[5]; curveSide=ls[6]; e=ls[7]; }
trackSpecification = TBMDesigner.Dynamo.KinematicEnvelopeCalculation.TrackSpecification(SpecJsonFilePath=railcorp_specifation_json_path)
getItemAtIndex = List.GetItemAtIndex(list=trackSpecification, index=index_of_track_type)
vechicleTypeList = TBMDesigner.Dynamo.KinematicEnvelopeCalculation.VechicleTypeList(VechicleJsonFilePath=vehicle_data_specification_json)
getItemAtIndex_2 = List.GetItemAtIndex(list=vechicleTypeList, index=index_of_vehicle_type)
kinematicEnvelope = TBMDesigner.Dynamo.KinematicEnvelopeCalculation.KinematicEnvelope(curveTypes=code_block_3.curveType, curveRadiuses=code_block_3.r, superElevations=code_block_3.e, curveSides=code_block_3.curveSide, sleeperType=code_block, SpecificationName=getItemAtIndex, vehicleType=getItemAtIndex_2, VechileDataFilePath=vehicle_data_specification_json, SpecificationPath=railcorp_specifation_json_path)
code_block_4 = CodeBlock(ls=kinematicEnvelope.KE1_Body_Roll_Positive_TT) { newls=List.Transpose(ls); x=newls[0]/1000; y=newls[1]/1000; pts=Point.ByCoordinates(x,y); }
code_block_5 = CodeBlock(ls=kinematicEnvelope.KE2_Bounce_Positive_TT) { newls=List.Transpose(ls); x=newls[0]/1000; y=newls[1]/1000; pts=Point.ByCoordinates(x,y); }
code_block_6 = CodeBlock(ls=kinematicEnvelope.KE3_Body_Roll_Negative_TT) { newls=List.Transpose(ls); x=newls[0]/1000; y=newls[1]/1000; pts=Point.ByCoordinates(x,y); }
code_block_7 = CodeBlock(ls=kinematicEnvelope.KE4_Bounce_Negative_TT) { newls=List.Transpose(ls); x=newls[0]/1000; y=newls[1]/1000; pts=Point.ByCoordinates(x,y); }
python_script = Python(IN[0]=code_block_4.pts, IN[1]=code_block_5.pts, IN[2]=code_block_6.pts, IN[3]=code_block_7.pts)
# ---------- python_script.python (36 lines) ----------
# Load the Python Standard and DesignScript Libraries
import sys
import clr

clr.AddReference('ProtoGeometry')

# Import Dynamo Geometry reference
import Autodesk.DesignScript.Geometry as DS

pts1=IN[0]
pts2=IN[1]
pts3=IN[2]
pts4=IN[3]
# Assign your output to the OUT variable.
OUT = []

for i in range(0, len(pts1)):
	cvs=[]
	
	p1s = pts1[i]
	cvs.append(DS.PolyCurve.ByPoints(DS.Point.PruneDuplicates(p1s), True))
	
	p2s = pts2[i]
	cvs.append(DS.PolyCurve.ByPoints(DS.Point.PruneDuplicates(p2s), True))
	
	p3s = pts3[i]
	cvs.append(DS.PolyCurve.ByPoints(DS.Point.PruneDuplicates(p3s), True))
	
	p4s = pts4[i]
	cvs.append(DS.PolyCurve.ByPoints(DS.Point.PruneDuplicates(p4s), True))
		

	OUT.append(cvs)

	
	
# ----------------------------------------
byPatch = Surface.ByPatch(closedCurve=python_script)
byUnion = Surface.ByUnion(surfaces=byPatch)
perimeterCurves = Surface.PerimeterCurves(surface=byUnion)
byJoinedCurves = PolyCurve.ByJoinedCurves(curves=perimeterCurves)
code_block_8 = CodeBlock { origin=Point.ByCoordinates(0,0,0); }
XAxis = Vector.XAxis()
reverse = Vector.Reverse(vector=XAxis)
ZAxis = Vector.ZAxis()
YAxis = Vector.YAxis()
byOriginVectors = CoordinateSystem.ByOriginVectors(origin=code_block_8, xAxis=reverse, yAxis=ZAxis, zAxis=YAxis)
code_block_9 = CodeBlock(x=code_block_3.x, y=code_block_3.y, z=code_block_3.z)
# ---------- code_block_9.designscript (4 lines) ----------
pts=Point.ByCoordinates(x,y,z);
pl=PolyCurve.ByPoints(pts);
pa=PolyCurve.ParameterAtPoint(pl, pts);
co=PolyCurve.CoordinateSystemAtParameter(pl, pa);
# ----------------------------------------
transform = Geometry.Transform(geometry=byJoinedCurves, fromCoordinateSystem=byOriginVectors, contextCoordinateSystem=code_block_9.co)
python_script_2 = Python(IN[0]=transform)
# ---------- python_script_2.python (18 lines) ----------
# Load the Python Standard and DesignScript Libraries
import sys
import clr
clr.AddReference('ProtoGeometry')
from Autodesk.DesignScript.Geometry import *

# The inputs to this node will be stored as a list in the IN variables.
data = IN[0]

# Place your code below this line

# Assign your output to the OUT variable.
OUT = []

for i in range(0, len(data)-1):
	d1 = data[i]
	d2 = data[i + 1]
	OUT.append([d1,d2])
# ----------------------------------------
byLoft = Solid.ByLoft(crossSections=python_script_2)
translate = Geometry.Translate(geometry=byLoft, xTranslation=project_base_point_easting, yTranslation=project_base_point_northing)
directory_from_path = DirectoryObject(path=sat_file_location)
code_block_10 = CodeBlock(dir=directory_from_path, railName=sheet_tab_name, envelopeName=getItemAtIndex_2) { dir+"\\"+railName+"_"+envelopeName+"_Combined"+".sat"; dir; railName; envelopeName; }
exportToSAT = ExportWithUnits(geometry=translate, filePath=code_block_10.out0, SelectedExportedUnitsSource=[0, 1, 2, 3, 5, 4], SelectedExportedUnit=2)
SLAB_TRACK = TBMDesigner.Domain.SleeperType.SLAB_TRACK()
WOODEN = TBMDesigner.Domain.SleeperType.WOODEN()
transform_2 = Geometry.Transform(geometry=code_block_4.pts, fromCoordinateSystem=byOriginVectors, contextCoordinateSystem=code_block_9.co)
translate_2 = Geometry.Translate(geometry=transform_2, xTranslation=project_base_point_easting, yTranslation=project_base_point_northing)
current = Autodesk.AutoCAD.DynamoNodes.Document.Current()
color_palette = ColorPalette({R: 0, G: 0, B: 255, A: 255})
code_block_11 = CodeBlock(doc=current, color2=color_palette) { Layer.Create("KE1",doc,color2,"Continuous","ByLineWeightDefault").Name; }
code_block_12 = CodeBlock(layer=code_block_11) { (layer==null? "KE1":layer); }
blocks = Autodesk.AutoCAD.DynamoNodes.Document.Blocks(document=current)
code_block_13 = CodeBlock(block=blocks) { block[0]; }
byPoints = Autodesk.AutoCAD.DynamoNodes.Polyline3D.ByPoints(points=translate_2, layer=code_block_12, block=code_block_13)
transform_3 = Geometry.Transform(geometry=code_block_5.pts, fromCoordinateSystem=byOriginVectors, contextCoordinateSystem=code_block_9.co)
translate_3 = Geometry.Translate(geometry=transform_3, xTranslation=project_base_point_easting, yTranslation=project_base_point_northing)
color_palette_2 = ColorPalette({R: 255, G: 127, B: 80, A: 255})
code_block_14 = CodeBlock(doc=current, color2=color_palette_2) { Layer.Create("KE2",doc,color2,"Continuous","ByLineWeightDefault").Name; }
code_block_15 = CodeBlock(layer=code_block_14) { (layer==null? "KE2":layer); }
byPoints_2 = Autodesk.AutoCAD.DynamoNodes.Polyline3D.ByPoints(points=translate_3, layer=code_block_15, block=code_block_13)
transform_4 = Geometry.Transform(geometry=code_block_6.pts, fromCoordinateSystem=byOriginVectors, contextCoordinateSystem=code_block_9.co)
translate_4 = Geometry.Translate(geometry=transform_4, xTranslation=project_base_point_easting, yTranslation=project_base_point_northing)
color_palette_3 = ColorPalette({R: 50, G: 205, B: 50, A: 255})
code_block_16 = CodeBlock(doc=current, color2=color_palette_3) { Layer.Create("KE3",doc,color2,"Continuous","ByLineWeightDefault").Name; }
code_block_17 = CodeBlock(layer=code_block_16) { (layer==null? "KE3":layer); }
byPoints_3 = Autodesk.AutoCAD.DynamoNodes.Polyline3D.ByPoints(points=translate_4, layer=code_block_17, block=code_block_13)
transform_5 = Geometry.Transform(geometry=code_block_7.pts, fromCoordinateSystem=byOriginVectors, contextCoordinateSystem=code_block_9.co)
translate_5 = Geometry.Translate(geometry=transform_5, xTranslation=project_base_point_easting, yTranslation=project_base_point_northing)
color_palette_4 = ColorPalette({R: 255, G: 255, B: 0, A: 255})
code_block_18 = CodeBlock(doc=current, color2=color_palette_4) { Layer.Create("KE4",doc,color2,"Continuous","ByLineWeightDefault").Name; }
code_block_19 = CodeBlock(layer=code_block_18) { (layer==null? "KE4":layer); }
byPoints_4 = Autodesk.AutoCAD.DynamoNodes.Polyline3D.ByPoints(points=translate_5, layer=code_block_19, block=code_block_13)
