# Dynamo graph C3D_DrawSection.dyn (Dynamo 2.4.1.6394)

chainage = DoubleInput(57170.5)
SLAB_TRACK = TBMDesigner.Domain.SleeperType.SLAB_TRACK()
WOODEN = TBMDesigner.Domain.SleeperType.WOODEN()

# group: get AutoCAD information and create layer
current = Autodesk.AutoCAD.DynamoNodes.Document.Current()
currentLayer = Autodesk.AutoCAD.DynamoNodes.Document.CurrentLayer(document=current)
blocks = Autodesk.AutoCAD.DynamoNodes.Document.Blocks(document=current)
code_block = CodeBlock(ls=blocks)
# ---------- code_block.designscript (2 lines) ----------
//get model space
ls[0];
# ----------------------------------------

CONCRETE = TBMDesigner.Domain.SleeperType.CONCRETE()

# group: Input
track_alignment_data_excel_file = StringInput("D:\_PROJECTs\60654007 Track Recon Stanwell Park\60654007 CDA centrelines at 1m intervals.xlsx")  # "Track alignment data excel file path"; graph input
sheet_tab_name = StringInput("Down Tunnel")  # graph input
project_base_point_easting = DoubleInput(297500)
project_base_point_northing = DoubleInput(1210600)
code_block_2 = CodeBlock(sleeper=CONCRETE) { sleeper; }
railcorp_specifation_json_path = StringInput("C:\Users\linp3\Source\Repos\peggylin-hub\TBMDesigner\TBMDesignerFunctions\Resources\RailcorpSpecs.json")  # graph input
index_of_track_type = DoubleSlider(1, range=0..6 step 1)  # graph input
vehicle_data_specification_json = StringInput("C:\Users\linp3\Source\Repos\peggylin-hub\TBMDesigner\TBMDesignerFunctions\Resources\VehicleData.json")  # "Vehicle Data Specification Json Path"; graph input
index_of_vehicle_type = DoubleSlider(7, range=0..16 step 1)  # graph input

file_from_path = FileObject(path=track_alignment_data_excel_file)
importExcel = Data.ImportExcel(file=file_from_path, sheetName=sheet_tab_name)
code_block_3 = CodeBlock(ls=importExcel)
# ---------- code_block_3.designscript (3 lines) ----------
//remove the table title
newls=List.DropItems(ls,1);
List.Transpose(newls);
# ----------------------------------------
code_block_4 = CodeBlock(ls=code_block_3.out1, x0=project_base_point_easting, y0=project_base_point_northing) { ch=ls[0]; x=ls[1]-x0; y=ls[2]-y0; z=ls[3]; r=ls[4]; curveType=ls[5]; curveSide=ls[6]; e=ls[7]; }
code_block_5 = CodeBlock(ls=code_block_4.ch, ch=chainage)
# ---------- code_block_5.designscript (7 lines) ----------
//first chainage
ch1=List.FirstItem(ls);

//last Chainage
ch2=List.LastItem(ls);

(ch-ch1)/(ch2-ch1);
# ----------------------------------------
code_block_6 = CodeBlock(x=code_block_4.x, y=code_block_4.y, z=code_block_4.z, para=code_block_5.out2) { pts=Point.ByCoordinates(x,y,z); pl=PolyCurve.ByPoints(pts); pt=PolyCurve.PointAtParameter(pl, para); }
python_script = Python(IN[0]=code_block_4.ch, IN[1]=chainage, IN[2]=code_block_4.r, IN[3]=code_block_4.curveType, IN[4]=code_block_4.curveSide, IN[5]=code_block_4.e)
# ---------- python_script.python (46 lines) ----------
# Load the Python Standard and DesignScript Libraries
import sys
import clr

# Add Assemblies for AutoCAD and Civil3D
clr.AddReference('AcMgd')
clr.AddReference('AcCoreMgd')
clr.AddReference('AcDbMgd')
clr.AddReference('AecBaseMgd')
clr.AddReference('AecPropDataMgd')
clr.AddReference('AeccDbMgd')

# Import references from AutoCAD
from Autodesk.AutoCAD.Runtime import *
from Autodesk.AutoCAD.ApplicationServices import *
from Autodesk.AutoCAD.EditorInput import *
from Autodesk.AutoCAD.DatabaseServices import *
from Autodesk.AutoCAD.Geometry import *

# Import references from Civil3D
from Autodesk.Civil.ApplicationServices import *
from Autodesk.Civil.DatabaseServices import *

# The inputs to this node will be stored as a list in the IN variables.
chs=IN[0]
ch =IN[1]
rs =IN[2]
cts =IN[3]#curve tyes
css =IN[4]#curve sides
es =IN[5]#superelevation
# Assign your output to the OUT variable.
OUT = []

index=0
for i in range(0, len(chs)-1):
	ch1 = chs[i]
	ch2 = chs[i + 1]
	
	if ch1 >= ch and ch <= ch2:
		index = i
		break

OUT.append(rs[index])
OUT.append(cts[index])
OUT.append(css[index])
OUT.append(es[index])
# ----------------------------------------
code_block_7 = CodeBlock(ls=python_script) { curvetype=ls[1]; curveRadius=ls[0]; superelevation=ls[3]; curveside=ls[2]; }
trackSpecification = TBMDesigner.Dynamo.KinematicEnvelopeCalculation.TrackSpecification(SpecJsonFilePath=railcorp_specifation_json_path)
getItemAtIndex = List.GetItemAtIndex(list=trackSpecification, index=index_of_track_type)
vechicleTypeList = TBMDesigner.Dynamo.KinematicEnvelopeCalculation.VechicleTypeList(VechicleJsonFilePath=vehicle_data_specification_json)
getItemAtIndex_2 = List.GetItemAtIndex(list=vechicleTypeList, index=index_of_vehicle_type)

# group: KE calculation
kinematicEnvelope = TBMDesigner.Dynamo.KinematicEnvelopeCalculation.KinematicEnvelope(curveTypes=code_block_7.curvetype, curveRadiuses=code_block_7.curveRadius, superElevations=code_block_7.superelevation, curveSides=code_block_7.curveside, sleeperType=code_block_2, SpecificationName=getItemAtIndex, vehicleType=getItemAtIndex_2, VechileDataFilePath=vehicle_data_specification_json, SpecificationPath=railcorp_specifation_json_path)

code_block_8 = CodeBlock(ls=kinematicEnvelope.KE0_Static)
# ---------- code_block_8.designscript (5 lines) ----------
newls=List.Transpose(ls);
x=newls[0]/1000;
y=newls[1]/1000;
pts=Point.ByCoordinates(x,y);
pt=Point.PruneDuplicates(pts);
# ----------------------------------------
color_palette = ColorPalette({R: 220, G: 20, B: 60, A: 255})
code_block_9 = CodeBlock(doc=current, color1=color_palette) { Layer.Create("KE0",doc,color1,"Continuous","ByLineWeightDefault").Name; }
code_block_10 = CodeBlock(layer=code_block_9) { (layer==null? "KE0":layer); }
byPoints = Autodesk.AutoCAD.DynamoNodes.Polyline.ByPoints(points=code_block_8.pt, layer=code_block_10, block=code_block)
code_block_11 = CodeBlock(ls=kinematicEnvelope.KE1_Body_Roll_Positive_TT)  # same code as code_block_8
color_palette_2 = ColorPalette({R: 0, G: 0, B: 255, A: 255})
code_block_12 = CodeBlock(doc=current, color2=color_palette_2) { Layer.Create("KE1",doc,color2,"Continuous","ByLineWeightDefault").Name; }
code_block_13 = CodeBlock(layer=code_block_12) { (layer==null? "KE1":layer); }
byPoints_2 = Autodesk.AutoCAD.DynamoNodes.Polyline.ByPoints(points=code_block_11.pt, layer=code_block_13, block=code_block)
code_block_14 = CodeBlock(ls=kinematicEnvelope.KE2_Bounce_Positive_TT)  # same code as code_block_8
color_palette_3 = ColorPalette({R: 124, G: 252, B: 0, A: 255})
code_block_15 = CodeBlock(doc=current, color3=color_palette_3) { Layer.Create("KE2",doc,color3,"Continuous","ByLineWeightDefault").Name; }
code_block_16 = CodeBlock(layer=code_block_15) { (layer==null? "KE2":layer); }
byPoints_3 = Autodesk.AutoCAD.DynamoNodes.Polyline.ByPoints(points=code_block_14.pt, layer=code_block_16, block=code_block)
code_block_17 = CodeBlock(ls=kinematicEnvelope.KE3_Body_Roll_Negative_TT)  # same code as code_block_8
color_palette_4 = ColorPalette({R: 255, G: 255, B: 0, A: 255})
code_block_18 = CodeBlock(doc=current, color4=color_palette_4) { Layer.Create("KE3",doc,color4,"Continuous","ByLineWeightDefault").Name; }
code_block_19 = CodeBlock(layer=code_block_18) { (layer==null? "KE3":layer); }
byPoints_4 = Autodesk.AutoCAD.DynamoNodes.Polyline.ByPoints(points=code_block_17.pt, layer=code_block_19, block=code_block)
code_block_20 = CodeBlock(ls=kinematicEnvelope.KE4_Bounce_Negative_TT)  # same code as code_block_8
color_palette_5 = ColorPalette({R: 148, G: 0, B: 211, A: 255})
code_block_21 = CodeBlock(doc=current, color5=color_palette_5) { Layer.Create("KE4",doc,color5,"Continuous","ByLineWeightDefault").Name; }
code_block_22 = CodeBlock(layer=code_block_21) { (layer==null? "KE4":layer); }
byPoints_5 = Autodesk.AutoCAD.DynamoNodes.Polyline.ByPoints(points=code_block_20.pt, layer=code_block_22, block=code_block)
code_block_23 = CodeBlock(ls=kinematicEnvelope.Structural_Gauge)  # same code as code_block_8
color_palette_6 = ColorPalette({R: 245, G: 255, B: 250, A: 255})
code_block_24 = CodeBlock(doc=current, color6=color_palette_6) { Layer.Create("KE5",doc,color6,"Continuous","ByLineWeightDefault").Name; }
code_block_25 = CodeBlock(layer=code_block_24) { (layer==null? "KE5":layer); }
byPoints_6 = Autodesk.AutoCAD.DynamoNodes.Polyline.ByPoints(points=code_block_23.pt, layer=code_block_25, block=code_block)
