# Dynamo graph Rvt.dyn (Dynamo 2.3.0.5885)

# group: Input
SLAB_TRACK = TBMDesigner.Domain.SleeperType.SLAB_TRACK()
WOODEN = TBMDesigner.Domain.SleeperType.WOODEN()
string = StringInput("D:\_PROJECTs\60654007 Track Recon Stanwell Park\60654007 CDA centrelines at 1m intervals.xlsx")
string_2 = StringInput("Down Tunnel")
project_base_point_easting = DoubleInput(297500)
project_base_point_northing = DoubleInput(1210600)
CONCRETE = TBMDesigner.Domain.SleeperType.CONCRETE()
code_block = CodeBlock(sleeper=CONCRETE) { sleeper; }
string_3 = StringInput("C:\Users\linp3\Source\Repos\peggylin-hub\TBMDesigner\TBMDesignerFunctions\Resources\RailcorpSpecs.json")
track_type = DoubleSlider(1, range=0..6 step 1)
string_4 = StringInput("C:\Users\linp3\Source\Repos\peggylin-hub\TBMDesigner\TBMDesignerFunctions\Resources\VehicleData.json")
vehicle_type = DoubleSlider(1, range=0..4 step 1)

file_from_path = FileObject(path=string)
importExcel = Data.ImportExcel(file=file_from_path, sheetName=string_2)
code_block_2 = CodeBlock(ls=importExcel)
# ---------- code_block_2.designscript (3 lines) ----------
//remove the table title
newls=List.DropItems(ls,1);
List.Transpose(newls);
# ----------------------------------------
code_block_3 = CodeBlock(ls=code_block_2.out1, x0=project_base_point_easting, y0=project_base_point_northing) { ch=ls[0]; x=ls[1]-x0; y=ls[2]-y0; z=ls[3]; r=ls[4]; curveType=ls[5]; curveSide=ls[6]; e=ls[7]; }
trackSpecification = TBMDesigner.Dynamo.KinematicEnvelopeCalculation.TrackSpecification(SpecJsonFilePath=string_3)
getItemAtIndex = List.GetItemAtIndex(list=trackSpecification, index=track_type)
vechicleTypeList = TBMDesigner.Dynamo.KinematicEnvelopeCalculation.VechicleTypeList(VechicleJsonFilePath=string_4)
getItemAtIndex_2 = List.GetItemAtIndex(list=vechicleTypeList, index=vehicle_type)
kinematicEnvelope = TBMDesigner.Dynamo.KinematicEnvelopeCalculation.KinematicEnvelope(curveTypes=code_block_3.curveType, curveRadiuses=code_block_3.r, superElevations=code_block_3.e, curveSides=code_block_3.curveSide, sleeperType=code_block, SpecificationName=getItemAtIndex, vehicleType=getItemAtIndex_2, VechileDataFilePath=string_4, SpecificationPath=string_3)
code_block_4 = CodeBlock(ls=kinematicEnvelope.KE0_Static) { newls=List.Transpose(ls); x=newls[0]/1000; y=newls[1]/1000; pts=Point.ByCoordinates(x,y); }
create_polylines = Python(IN[0]=code_block_4.pts)
# ---------- create_polylines.python (17 lines) ----------
# Load the Python Standard and DesignScript Libraries
import sys
import clr
clr.AddReference('ProtoGeometry')
from Autodesk.DesignScript.Geometry import *

# The inputs to this node will be stored as a list in the IN variables.
points = IN[0]

# Place your code below this line

# Assign your output to the OUT variable.
OUT = []

for pts in points:
	pt = Point.PruneDuplicates(pts)
	OUT.append( PolyCurve.ByPoints(pt, True))
# ----------------------------------------
code_block_5 = CodeBlock { origin=Point.ByCoordinates(0,0,0); }
XAxis = Vector.XAxis()
reverse = Vector.Reverse(vector=XAxis)
ZAxis = Vector.ZAxis()
YAxis = Vector.YAxis()
byOriginVectors = CoordinateSystem.ByOriginVectors(origin=code_block_5, xAxis=reverse, yAxis=ZAxis, zAxis=YAxis)
code_block_6 = CodeBlock(x=code_block_3.x, y=code_block_3.y, z=code_block_3.z)
# ---------- code_block_6.designscript (4 lines) ----------
pts=Point.ByCoordinates(x,y,z);
pl=PolyCurve.ByPoints(pts);
pa=PolyCurve.ParameterAtPoint(pl, pts);
co=PolyCurve.CoordinateSystemAtParameter(pl, pa);
# ----------------------------------------
transform = Geometry.Transform(geometry=create_polylines, fromCoordinateSystem=byOriginVectors, contextCoordinateSystem=code_block_6.co)
python_script = Python(IN[0]=transform)
# ---------- python_script.python (18 lines) ----------
# Load the Python Standard and DesignScript Libraries
import sys
import clr
clr.AddReference('ProtoGeometry')
from Autodesk.DesignScript.Geometry import *

# The inputs to this node will be stored as a list in the IN variables.
data = IN[0]

# Place your code below this line

# Assign your output to the OUT variable.
OUT = []

for i in range(0, len(data)-1):
	d1 = data[i]
	d2 = data[i + 1]
	OUT.append([d1,d2])
# ----------------------------------------
code_block_7 = CodeBlock(ls=python_script) { i1=List.GetItemAtIndex(ls,0); i2=List.GetItemAtIndex(ls,1); i3=List.GetItemAtIndex(ls,2); [i1,i2,i3]; }
byLoft = Solid.ByLoft(crossSections=python_script)
byGeometry = ImportInstance.ByGeometry(geometry=byLoft)
python_script_2 = Python(IN[0]=byGeometry)  # frozen
# ---------- python_script_2.python (19 lines) ----------
# Load the Python Standard and DesignScript Libraries
import sys
import clr
clr.AddReference('ProtoGeometry')
from Autodesk.DesignScript.Geometry import *

# The inputs to this node will be stored as a list in the IN variables.
instances = IN[0]
chs = IN[1]
# Place your code below this line

# Assign your output to the OUT variable.
OUT = []

for i in range(0, len(instances)):
	ins = instances[i]
	ch = chs[i]
	
	
# ----------------------------------------
