# Dynamo graph Rvt_AddChainage.dyn (Dynamo 2.3.0.5885)

family_types = FamilyTypes("GEN_CHAINAGE-PLACEHOLDER:PlaceHolder")

# group: Input
string = StringInput("D:\_PROJECTs\60654007 Track Recon Stanwell Park\60654007 CDA centrelines at 1m intervals.xlsx")
string_2 = StringInput("Down Tunnel")
project_base_point_easting = DoubleInput(297500)
project_base_point_northing = DoubleInput(1210600)

file_from_path = FileObject(path=string)
importExcel = Data.ImportExcel(file=file_from_path, sheetName=string_2)
code_block = CodeBlock(ls=importExcel)
# ---------- code_block.designscript (3 lines) ----------
//remove the table title
newls=List.DropItems(ls,1);
List.Transpose(newls);
# ----------------------------------------
code_block_2 = CodeBlock(ls=code_block.out1, x0=project_base_point_easting, y0=project_base_point_northing) { ch=ls[0]; x=ls[1]-x0; y=ls[2]-y0; z=ls[3]; r=ls[4]; curveType=ls[5]; curveSide=ls[6]; e=ls[7]; }
byCoordinates = FamilyInstance.ByCoordinates(familyType=family_types, x=code_block_2.x, y=code_block_2.y)
code_block_3 = CodeBlock(x=code_block_2.x, y=code_block_2.y)
# ---------- code_block_3.designscript (4 lines) ----------
pts=Point.ByCoordinates(x,y,0);
pl=PolyCurve.ByPoints(pts);
pa=PolyCurve.ParameterAtPoint(pl, pts);
co=PolyCurve.CoordinateSystemAtParameter(pl, pa);
# ----------------------------------------
code_block_4 = CodeBlock(coordSystems=code_block_3.co)
# ---------- code_block_4.designscript (4 lines) ----------
sectionLocations = coordSystems.Origin;
directions = coordSystems.YAxis;
planes = Plane.ByOriginNormal(sectionLocations, directions);
rotations = Vector.AngleAboutAxis(Vector.YAxis(), directions, Vector.ZAxis());
# ----------------------------------------
code_block_5 = CodeBlock(e=byCoordinates, alpha=code_block_4.rotations, z=code_block_2.z, ch=code_block_2.ch)
# ---------- code_block_5.designscript (7 lines) ----------
e.SetParameterByName("Rot_Plan", alpha);
e.SetParameterByName("Hts_Top", z+6);
e.SetParameterByName("Hts_Bottom", z);

e.SetParameterByName("Txt_Bottom", ""+ch);
e.SetParameterByName("Txt_Chainage", ""+ch);
e.SetParameterByName("Txt_Top", ""+ch);
# ----------------------------------------
family_types_2 = FamilyTypes("GEN_CHAINAGE-PLACEHOLDER:PlaceHolder")
file_from_path_2 = FileObject(path=string)
string_3 = StringInput("Up Tunnel")
importExcel_2 = Data.ImportExcel(file=file_from_path_2, sheetName=string_3)
code_block_6 = CodeBlock(ls=importExcel_2)  # same code as code_block
code_block_7 = CodeBlock(ls=code_block_6.out1, x0=project_base_point_easting, y0=project_base_point_northing) { ch=ls[0]; x=ls[1]-x0; y=ls[2]-y0; z=ls[3]; r=ls[4]; curveType=ls[5]; curveSide=ls[6]; e=ls[7]; }
byCoordinates_2 = FamilyInstance.ByCoordinates(familyType=family_types_2, x=code_block_7.x, y=code_block_7.y)
code_block_8 = CodeBlock(x=code_block_7.x, y=code_block_7.y)  # same code as code_block_3
code_block_9 = CodeBlock(coordSystems=code_block_8.co)  # same code as code_block_4
code_block_10 = CodeBlock(e=byCoordinates_2, alpha=code_block_9.rotations, z=code_block_7.z, ch=code_block_7.ch)  # same code as code_block_5
