# Dynamo graph convertData.dyn (Dynamo 2.3.0.5885)

# group: Input
string = StringInput("C:\Users\linp3\Source\Repos\peggylin-hub\TBMDesigner\TBMDesignerFunctions\ReferenceDoc\KE Calculation\KE_Calculator_v2.3.xlsm")
string_2 = StringInput("Vehicle & Track Data")

file_from_path = FileObject(path=string)
importExcel = Data.ImportExcel(file=file_from_path, sheetName=string_2)
code_block = CodeBlock(ls=importExcel)
# ---------- code_block.designscript (12 lines) ----------
l1=List.DropItems(ls,2);
//x
List.TakeItems(l1,17);

l2=List.DropItems(l1,19);
//y
List.TakeItems(l2, 17);

l3=List.DropItems(l2, 21);

//others
List.TakeItems(l3,17);
# ----------------------------------------
transpose = List.Transpose(lists=code_block.out5)
transpose_2 = List.Transpose(lists=code_block.out3)
transpose_3 = List.Transpose(lists=code_block.out1)
code_block_2 = CodeBlock {  }
watch = Watch(code_block.out1)
string_3 = StringInput("d:\temp.txt")
python_script = Python(IN[0]=code_block.out1, IN[1]=code_block.out3, IN[2]=code_block.out5)
# ---------- python_script.python (42 lines) ----------
# Load the Python Standard and DesignScript Libraries
import sys
import clr
clr.AddReference('ProtoGeometry')
from Autodesk.DesignScript.Geometry import *

# The inputs to this node will be stored as a list in the IN variables.
xs = IN[0]
ys = IN[1]
others = IN[2]

# Place your code below this line

# Assign your output to the OUT variable.
OUT = []

for i in range(0, len(xs)):
	d={}
	xData = xs[i]
	yData = ys[i]
	oData = others[i]
	
	d.update({"VehicleType": xData[0]})
	hdata = []
	for n in range(1, 29):
		hdata.append(xData[n])
	vdata = []
	for n in range(1, 29):
		vdata.append(yData[n])
	d.update({"HorizontalData": hdata})
	d.update({"VerticalData" : vdata})
	
	d.update({"BogieCentres" : oData[1]})
	d.update({"BodyOverhang" : oData[2]})
	d.update({"Length" : oData[3]})
	d.update({"Width" : oData[4]})
	d.update({"MaximumBodyRolldeg" : oData[5]})
	d.update({"Bounce" : oData[6]})
	d.update({"LateralTolerance" : oData[7]})
	d.update({"TrackGauge" : xData[29]})
	OUT.append(d)
	
# ----------------------------------------
stringifyJSON = Data.StringifyJSON(values=python_script)
writeText = FileSystem.WriteText(filePath=string_3, text=stringifyJSON)
