# Grasshopper definition grasshopper test.gh (Grasshopper 1.0.7)
# plug-ins: LunchBox, TBMDesignerGrasshopper, Kangaroo2 Components

panel = Panel("C:\Users\LinP3\source\repos\Dynamo\KinematicDynamoNode\KinematicDynamoNode\resource\test data_CRL_MC20.xlsx")
excel_reader = ExcelReader(ReadExcelData=True, WorkbookPath=panel, WorksheetName="Sheet1")  # -> Exceptions, ExcelData
cull_index = CullIndex(List=excel_reader.ExcelData, Indices=0, Wrap=True)

# ---- group: Station
tree_branch = TreeBranch(Tree=cull_index, Path="{0;0}", MaintainPaths=True)

# ---- group: CurveSide
tree_branch_2 = TreeBranch(Tree=cull_index, Path="{6;0}", MaintainPaths=True)

# ---- group: x
tree_branch_3 = TreeBranch(Tree=cull_index, Path="{1;0}", MaintainPaths=True)

# ---- group: Y
tree_branch_4 = TreeBranch(Tree=cull_index, Path="{2;0}", MaintainPaths=True)

# ---- group: Z
tree_branch_5 = TreeBranch(Tree=cull_index, Path="{3;0}", MaintainPaths=True)

# ---- group: SuperElevation
tree_branch_6 = TreeBranch(Tree=cull_index, Path="{7;0}", MaintainPaths=True)

# ---- group: Radius
tree_branch_7 = TreeBranch(Tree=cull_index, Path="{4;0}", MaintainPaths=True)

# ---- group: Curve Type
tree_branch_8 = TreeBranch(Tree=cull_index, Path="{5;0}", MaintainPaths=True)

# ----
construct_point = ConstructPoint(XCoordinate=tree_branch_3, YCoordinate=tree_branch_4, ZCoordinate=tree_branch_5)
polyline = PolyLine(Vertices=construct_point, Closed=False)
curve_closest_point = CurveClosestPoint(Point=construct_point, Curve=reparameterize(polyline))  # -> Point, Parameter, Distance
perp_frame = PerpFrame(Curve=reparameterize(polyline), Parameter=curve_closest_point.Parameter)

panel_2 = Panel(tree_branch_6)
shatter = Shatter()

number_slider = Slider(100, range=0..100)
number_slider_2 = Slider(20, range=0..100)
panel_3 = Panel("Curve")
panel_4 = Panel("Left")
boolean = Boolean(True)
file_path = FilePath("C:\Users\LinP3\source\repos\Dynamo\KinematicDynamoNode\KinematicDynamoNode\RailcorpSpecs.json")
file_path_2 = FilePath("C:\Users\LinP3\source\repos\Dynamo\KinematicDynamoNode\KinematicDynamoNode\VehicleData.json")
tbmdesigner_grasshopper = TBMDesignerGrasshopper(
    CurveType=tree_branch_8,
    CurveRadius=tree_branch_7,
    SuperElevation=tree_branch_6,
    CurveSide=tree_branch_2,
    TrackSleeperType="concrete",
    SpecificationName="Plain Line - Concrete",
    VehicleType="Narrow Non-Electric",
    VehicleDataFilePath=file_path_2,
    SpecificationPath=file_path,
    VerticalTrackTolerance=boolean,
    PointTolerance=Slider(0.01, range=0..0.01))  # -> KE0Static, KE1BodyRollPositiveTT, KE2BouncePositiveTT, KE3BodyRollNegativeTT, KE4BounceNegativeTT, StructuralGauge, Warnings
panel_5 = Panel(tbmdesigner_grasshopper.KE0Static)
panel_6 = Panel(tbmdesigner_grasshopper.KE1BodyRollPositiveTT)
panel_7 = Panel(tbmdesigner_grasshopper.KE2BouncePositiveTT)
panel_8 = Panel(tbmdesigner_grasshopper.KE4BounceNegativeTT)
panel_9 = Panel(tbmdesigner_grasshopper.StructuralGauge)
panel_10 = Panel(tbmdesigner_grasshopper.Warnings)
panel_11 = Panel(tbmdesigner_grasshopper.KE3BodyRollNegativeTT)
removeduplicatepts = RemoveDuplicatePts(Points=panel_6, Tolerance=0.01)  # disabled
removeduplicatepts_2 = RemoveDuplicatePts(Points=panel_5, Tolerance=0.01)  # disabled
removeduplicatepts_3 = RemoveDuplicatePts(Points=panel_7, Tolerance=0.01)  # disabled
removeduplicatepts_4 = RemoveDuplicatePts(Points=panel_8, Tolerance=0.01)  # disabled
removeduplicatepts_5 = RemoveDuplicatePts(Points=panel_11, Tolerance=0.01)  # disabled
polyline_2 = PolyLine(Vertices=removeduplicatepts_2, Closed=True)
polyline_3 = PolyLine(Vertices=removeduplicatepts, Closed=True)
polyline_4 = PolyLine(Vertices=removeduplicatepts_3, Closed=True)
polyline_5 = PolyLine(Vertices=removeduplicatepts_4, Closed=True)
polyline_6 = PolyLine(Vertices=removeduplicatepts_5, Closed=True)
polyline_7 = PolyLine(Vertices=panel_9, Closed=True)  # disabled

xy_plane = XYPlane(Origin=Point(0, 0, 0))
rotate = Rotate(Geometry=tbmdesigner_grasshopper.KE0Static, Angle=-1.570796327, Plane=xy_plane)  # -> Geometry, Transform
orient = Orient(Geometry=rotate.Geometry, Source=xy_plane, Target=perp_frame)  # -> Geometry, Transform
loft_options = LoftOptions(Closed=False, Adjust=False, Rebuild=0, Refit=0, Type=0)
loft = Loft(Curves=orient.Geometry, Options=loft_options)
cap_holes = CapHoles(Brep=loft)
